# Grasshopper definition 3DVectorAnalysis.gh (Grasshopper 0.9.76)
# plug-ins: Python Interpreter

crv = Curve(<curve referenced from the Rhino model>)

pt = ConstructPoint(XCoordinate=0, YCoordinate=0, ZCoordinate=0)
end = EndPoints(Curve=crv)  # -> Start, End
ln = Line(StartPoint=end.Start, EndPoint=pt)

move = Move(Geometry=crv, Motion=ln)  # -> Geometry, Transform
divide = DivideCurve(Curve=move.Geometry, Count=10, Kinks=False)  # -> Points, Tangents, Parameters

line = LineSDL(Start=divide.Points, Direction=divide.Tangents, Length=Slider(3.35, range=0..5))

# ----
# Get angles X
xy = XYPlane(Origin=Point(0, 0, 0))
project = Project(Geometry=line, Plane=xy)  # -> Geometry, Transform
X = UnitX(Factor=1)
angle = Angle(VectorA=project.Geometry, VectorB=X)  # -> Angle, Reflex
item = ListItem(List=angle.Angle, Index=0, Wrap=True)
ins = InsertItems(List=angle.Angle, Item=item, Indices=0, Wrap=True)
shift = ShiftList(List=ins, Shift=1, Wrap=True)
subtraction = Subtraction(A=shift, B=ins)

# ----
# Get angles Z
yz = YZPlane(Origin=Point(0, 0, 0))
project_2 = Project(Geometry=line, Plane=yz)  # -> Geometry, Transform
Z = UnitZ(Factor=1)
angle_2 = Angle(VectorA=project_2.Geometry, VectorB=Z)  # -> Angle, Reflex
item_2 = ListItem(List=angle_2.Angle, Index=0, Wrap=True)
ins_2 = InsertItems(List=angle_2.Angle, Item=item_2, Indices=0, Wrap=True)
shift_2 = ShiftList(List=ins_2, Shift=1, Wrap=True)
subtraction_2 = Subtraction(A=shift_2, B=ins_2)

len = Length(Curve=line)
python = PythonScript(XY=subtraction, Z=subtraction_2, Length=len)  # -> out, a; inputs XY: list, Z: list, Length: list
# ---------- python: Python ----------
wiretest = open("D:/Dropbox/123Parsons/wiretest.txt", "w")

XY = XY[:-1]
Z = Z[:-1]

for i in range(len(XY)):
    print Length[i],'\t',XY[i],'\t',Z[i]
    wiretest.write( str(Length[i]) )
    wiretest.write( '\t' )
    wiretest.write( str(XY[i]) )
    wiretest.write( '\t' )
    wiretest.write( str(Z[i]) )
    wiretest.write( '\n' )
wiretest.close()
# ---------- end python ----------
