# Grasshopper definition Find3DVect.gh (Grasshopper 0.9.76)
# plug-ins: Python Interpreter

origin = ConstructPoint(XCoordinate=0, YCoordinate=0, ZCoordinate=0)
number_slider = Slider(3, range=1..124)
divide_line_into_points = DivideCurve(Curve=<geometry referenced from the Rhino model>, Count=number_slider, Kinks=False)  # -> Points, Tangents, Parameters
get_first_point = ListItem(List=divide_line_into_points.Points, Index=0, Wrap=True)
translation = Line(StartPoint=get_first_point, EndPoint=origin)
move_the_curve_to_origin = Move(Geometry=<curve referenced from the Rhino model>, Motion=translation)  # -> Geometry, Transform
divide_line_into_points_2 = DivideCurve(Curve=move_the_curve_to_origin.Geometry, Count=number_slider, Kinks=False)  # -> Points, Tangents, Parameters
_3d_move_to_point = Line(StartPoint=origin, EndPoint=divide_line_into_points_2.Points)
shift_points_by_1 = ShiftList(List=divide_line_into_points_2.Points, Shift=1, Wrap=True)
remove_last_index = CullIndex(List=shift_points_by_1, Indices=number_slider, Wrap=True)
segments = Line(StartPoint=divide_line_into_points_2.Points, EndPoint=remove_last_index)
last_segment = Move(Geometry=segments, Motion=segments)  # -> Geometry, Transform
python = PythonScript(x=Line((0, 0, 0), (0, 1, 0)))  # -> out, a; inputs x: Line, y: Line
# ---------- python: Python ----------
def getCoords(linePoints):
    temp = str(linePoints).split(',')
    firstPoint = temp[:3]
    secondPoint = temp[3:]
    return firstPoint, secondPoint

#def dotproduct(v1,v2):
#    return sum((a*b) for a,b in zip(v1,v2))

xCoords = getCoords(x)
yCoords = getCoords(y)

xCoordsInt = map(float,xCoords[1])
yCoordsInt = map(float,yCoords[1])


"""
make a comparison between the old and new in terms of tools
make the manual for the future when the manual is outdated
"""
# ---------- end python ----------
line = Line(segments)
xy = XYPlane(Origin=Point(0, 0, 0))
project = Project(Geometry=line, Plane=xy)  # -> Geometry, Transform
yz = YZPlane(Origin=Point(0, 0, 0))
project_2 = Project(Geometry=line, Plane=yz)  # -> Geometry, Transform
xz = XZPlane(Origin=Point(0, 0, 0))
project_3 = Project(Geometry=line, Plane=xz)  # -> Geometry, Transform
line_2 = Line(project_3.Geometry)
line_3 = Line(project_2.Geometry)
line_4 = Line(project.Geometry)
pt = ConstructPoint(XCoordinate=0, YCoordinate=0, ZCoordinate=0)
pt_2 = ConstructPoint(XCoordinate=Slider(1, range=0..1), YCoordinate=Slider(0, range=0..1), ZCoordinate=Slider(0, range=0..1))
pt_3 = ConstructPoint(XCoordinate=0, YCoordinate=0, ZCoordinate=0)
pt_4 = ConstructPoint(XCoordinate=Slider(0, range=0..1), YCoordinate=Slider(1, range=0..1), ZCoordinate=Slider(0, range=0..1))
pt_5 = ConstructPoint(XCoordinate=0, YCoordinate=0, ZCoordinate=0)
pt_6 = ConstructPoint(XCoordinate=Slider(0, range=0..1), YCoordinate=Slider(0, range=0..1), ZCoordinate=Slider(1, range=0..1))
end = EndPoints(Curve=line_2)  # -> Start, End
end_2 = EndPoints(Curve=line_4)  # -> Start, End
end_3 = EndPoints(Curve=line_3)  # -> Start, End
z_move_ln = Line(StartPoint=end_2.Start, EndPoint=divide_line_into_points_2.Points)
x_move_ln = Line(StartPoint=end_3.Start, EndPoint=divide_line_into_points_2.Points)
y_move_ln = Line(StartPoint=end.Start, EndPoint=divide_line_into_points_2.Points)
y_reference_line = Line(StartPoint=pt_3, EndPoint=pt_4)
z_rotations = Move(Geometry=line_4, Motion=z_move_ln)  # -> Geometry, Transform
cull_i = CullIndex(List=z_rotations.Geometry, Indices=number_slider, Wrap=True)
repeat = RepeatData(Data=y_reference_line, Length=number_slider)
xy_rotation = Angle(VectorA=repeat, VectorB=cull_i)  # -> Angle, Reflex
len = Length(Curve=line)
panel = Panel(xy_rotation.Angle)
cull_i_2 = CullIndex(List=len, Indices=number_slider, Wrap=True)
ins = InsertItems(List=cull_i_2, Item=0, Indices=0, Wrap=True)
shift = ShiftList(List=ins, Shift=1, Wrap=True)
x_rotations = Move(Geometry=line_3, Motion=x_move_ln)  # -> Geometry, Transform
z_reference_line = Line(StartPoint=pt_5, EndPoint=pt_6)
addition = Addition(A=ins, B=shift)
cull_i_3 = CullIndex(List=x_rotations.Geometry, Indices=number_slider, Wrap=True)
repeat_2 = RepeatData(Data=z_reference_line, Length=number_slider)
cull_i_4 = CullIndex(List=addition, Indices=number_slider, Wrap=True)
yz_rotation = Angle(VectorA=repeat_2, VectorB=cull_i_3)  # -> Angle, Reflex
ins_2 = InsertItems(List=cull_i_4, Item=0, Indices=0, Wrap=True)
panel_2 = Panel(yz_rotation.Angle)
pt_7 = ConstructPoint(XCoordinate=0, YCoordinate=ins_2, ZCoordinate=0)
shift_2 = ShiftList(List=ins_2, Shift=1, Wrap=True)
pt_8 = ConstructPoint(XCoordinate=0, YCoordinate=shift_2, ZCoordinate=0)
cull_i_5 = CullIndex(List=pt_7, Indices=number_slider, Wrap=True)
cull_i_6 = CullIndex(List=pt_8, Indices=number_slider, Wrap=True)
y_rotations = Move(Geometry=line_2, Motion=y_move_ln)  # -> Geometry, Transform
x_reference_line = Line(StartPoint=pt, EndPoint=pt_2)
ln = Line(StartPoint=cull_i_5, EndPoint=cull_i_6)
cull_i_7 = CullIndex(List=y_rotations.Geometry, Indices=number_slider, Wrap=True)
repeat_3 = RepeatData(Data=x_reference_line, Length=number_slider)
xz_rotation = Angle(VectorA=repeat_3, VectorB=cull_i_7)  # -> Angle, Reflex
panel_3 = Panel(xz_rotation.Angle)
